# Dynamo graph ChangeFilename.dyn (Dynamo 0.8.1.1345)

file_path = Filename("..\..\..\test\core\excel\mixedNumbersAndStrings.xlsx")
fromPath = FileObject(file_path)  # "File.FromPath"
string = StringInput("Sheet1")
readFromFile = Excel.ReadFromFile(fromPath, string)
watch = Watch(readFromFile)
code_block = CodeBlock { "C:\..\..\\test\core\excel\mixedNumbersAndStrings_2.xlsx"; }
