# Dynamo graph Excel_MAGN7213_2.dyn (Dynamo 0.8.1.1345)

file_path = Filename("..\..\..\test\core\excel\Excel_MAGN7213_2.xlsx")
code_block = CodeBlock { "Sheet1"; }
number = DoubleInput(0)
code_block_2 = CodeBlock { {2,null,3}; }
writeToFile = Excel.WriteToFile(file_path, code_block, number, number, code_block_2)
watch = Watch(writeToFile)
