# Dynamo graph ReadNonExistingFile.dyn (Dynamo 0.8.1.1345)

code_block = CodeBlock { "..\..\..\\test\core\excel\NonExistingFile.xlsx"; }
string = StringInput("Sheet1")
readFromFile = Excel.ReadFromFile(code_block, string)
watch = Watch(readFromFile)
