# Dynamo graph WriteWrongPath.dyn (Dynamo 0.8.1.1345)

watch = Watch()
code_block = CodeBlock { "..\..\..\test\core\excel\WriteToNonExistingFile.xlsx"; }
string = StringInput("Sheet1")
code_block_2 = CodeBlock { 0; }
code_block_3 = CodeBlock { 1..5; }
writeToFile = Excel.WriteToFile(code_block, string, code_block_2, code_block_2, code_block_3)
