# Dynamo graph webrequest.dyn (Dynamo 0.8.1.1440)

code_block = CodeBlock { "https://www.random.org/integers/?num=1&min=1&max=100&col=1&base=10&format=plain&rnd=new"; }
web_request = WebRequest(code_block)
